# Grasshopper definition demo2.gh (Grasshopper 1.0.5)

cluster = Cluster(path="D:\RhinoProject\GhPthon/demo2.py")
panel = Panel(cluster)
shift = ShiftList(List=panel, Shift=1, Wrap=True)
panel_2 = Panel(shift)
pt = Point(panel)
ln = Line(StartPoint=panel_2, EndPoint=pt)
panel_3 = Panel(ln)
item = ListItem(List=ln, Index=Slider(2, range=0..10), Wrap=True)
item_2 = ListItem(List=ln, Index=Slider(1, range=0..10), Wrap=True)
item_3 = ListItem(List=ln, Index=Slider(0, range=0..10), Wrap=True)
item_4 = ListItem(List=ln, Index=Slider(3, range=0..10), Wrap=True)
edgesrf = EdgeSurface(CurveA=item_3, CurveB=item_2, CurveC=item, CurveD=item_4)

# ==== cluster Cluster
path = ClusterInput()
path_2 = FilePath(path)
file = ReadFile(File=path_2, PerLineParse=False)
python = GhPythonScript(Code=file, Area=Slider(100, range=0..100), Y=Slider(14, range=0..100))  # -> Out, A, B, C
out = ClusterOutput(python.Out)
